# Grasshopper definition 01_basic_definition.gh (Grasshopper 1.0.7)
# plug-ins: Bifocals

# ----
# 2 - Geometry Base
x_value = Slider(60, range=1..100)
y_value = Slider(69, range=1..100)
z_value = Slider(1, range=1..100)
construct_point = ConstructPoint(XCoordinate=x_value, YCoordinate=y_value, ZCoordinate=z_value)

# ----
# 3 - Sphere Radius
radius = Slider(7, range=1..100)

# ----
# 4 - Widget 'Arm' Start
y_value_2 = Slider(100, range=1..100)
x_value_2 = Slider(84, range=1..100)
z_value_2 = Slider(100, range=1..100)
construct_point_2 = ConstructPoint(XCoordinate=x_value_2, YCoordinate=y_value_2, ZCoordinate=z_value_2)

# ----
# 5 - Center Line of Arm
line = Line(StartPoint=construct_point, EndPoint=construct_point_2)

# ----
# 8 - Analysis
desired_arm_length = Slider(100, range=1..100)
length = Length(Curve=line)
subtraction = Subtraction(A=desired_arm_length, B=length)
absolute = Absolute(Value=subtraction)
panel = Panel(absolute)

# ----
# 6 - Arm Thickness
pipe = Pipe(Curve=line, Radius=expr("x/2", radius), Caps=1)

# ----
# 1 - Geometry
sphere = Sphere(Base=construct_point, Radius=radius)

# ----
# 7 - Boolean Difference
solid_difference = SolidDifference(BrepsA=sphere, BrepsB=pipe)

# ----
# 9 - Display
gradient = Gradient(LowerLimit=0, UpperLimit=100, Parameter=absolute, stops=[0: RGB(0, 128, 0), 0.5: RGB(255, 255, 0), 1: RGB(255, 0, 0)])
custom_preview = CustomPreview(Geometry=[solid_difference, pipe], Material=gradient)
