# Grasshopper definition 02_refRhino_geoConcepts.gh (Grasshopper 1.0.7)
# plug-ins: Bifocals

# 2
curve = Curve([<curve referenced from the Rhino model> x3])
# 1
mesh = Mesh(<mesh referenced from the Rhino model>)
# 3
loft = Loft(Curves=curve, Options={Adjust=False, Closed=False, LoftEnds=0, LoftSimp=0, LoftType=0, Rebuild=10, Refit=0.01})
# 5
bounding_box = BoundingBox(Content=mesh, Plane=PlaneXY(0, 0, 0))  # -> Box, Box_2

# ----
# 4
md_slider = MDSlider(
    SliderMode=0,
    slider_value=Point(0.459665873, 0.5960339802, 0.5),
    x_domain=Domain(0, 1),
    y_domain=Domain(0, 1),
    z_domain=Domain(0, 1))
evaluate_surface = EvaluateSurface(Surface=reparameterize(loft), Point=md_slider)  # -> Point, Normal, UDirection, VDirection, Frame

# ----
# 6
box_corners = BoxCorners(Box=bounding_box.Box)  # -> CornerA, CornerB, CornerC, CornerD, CornerE, CornerF, CornerG, CornerH
average = Average(Input=[box_corners.CornerA, box_corners.CornerC])

# ----
# 9
number_slider = Slider(39, range=0..360)
rotate_plane = RotatePlane(Plane=evaluate_surface.Frame, Angle=degrees(number_slider))

# ----
# 7
vector_2pt = Vector2Pt(PointA=average, PointB=evaluate_surface.Point, Unitize=False)  # -> Vector, Length
move = Move(Geometry=mesh, Motion=vector_2pt.Vector)  # -> Geometry, Transform

# ----
# 10
xy_plane = XYPlane(Origin=average)
orient = Orient(Geometry=mesh, Source=xy_plane, Target=rotate_plane)  # -> Geometry, Transform

vector_display = VectorDisplay(Anchor=evaluate_surface.Point, Vector=vector_2pt.Vector)

# ---- group: Vector Display
# 8
vector_display_2 = VectorDisplay(Anchor=average, Vector=vector_2pt.Vector)
