# Grasshopper definition 03_DATA.gh (Grasshopper 1.0.7)
# plug-ins: Bifocals

# ----
# TOPIC 1 - INDICES
mesh = Mesh([<mesh referenced from the Rhino model> x4])

# ----
# YOU CAN ACCESS AN
# ITEM BY ITS INDEX. IF
# WRAP IS SET TO TRUE
# YOU CAN OFFSET FROM
# THE END OF THE LIST,
# AND MOVE BACKWARDS.
number_slider = Slider(0, range=-3..3)
list_item = ListItem(List=mesh, Index=number_slider, Wrap=True)

mesh_2 = Mesh([<mesh referenced from the Rhino model> x4])
mesh_3 = Mesh([<mesh referenced from the Rhino model> x4])

# ---- group: making sure we only have 4 points to project to
you_ll_see_that_this_doesn_t_really_work = Slider(15, range=5..20)
# TRY THIS LIST LENGTH VS
# THE SLIDER.
used_instead_of_the_slider_below = ListLength(List=mesh_3)
number_slider_2 = Slider(489, range=1..1000)
random = Random(Range=Domain(0, 1), Number=you_ll_see_that_this_doesn_t_really_work, Seed=expr("X*pi", number_slider_2))
random_2 = Random(Range=Domain(0, 1), Number=you_ll_see_that_this_doesn_t_really_work, Seed=number_slider_2)
construct_point = ConstructPoint(XCoordinate=random_2, YCoordinate=random, ZCoordinate=0)

# ----
mesh_4 = Mesh(simplify(graft([<mesh referenced from the Rhino model> x4])))

# ---- group: making sure we only have 4 points to project to
number_slider_3 = Slider(737, range=1..1000)
of_trees = Slider(72, range=5..100)
random_3 = Random(Range=Domain(0, 1), Number=of_trees, Seed=expr("X*pi", number_slider_3))
random_4 = Random(Range=Domain(0, 1), Number=of_trees, Seed=number_slider_3)
construct_point_2 = ConstructPoint(XCoordinate=random_4, YCoordinate=random_3, ZCoordinate=0)

# ---- group: CENTER POINTS FOR ALL THE MESHES
bounding_box = BoundingBox(Content=mesh_3, Plane=PlaneXY(0, 0, 0))  # -> Box, Box_2
volume = Volume(Geometry=bounding_box.Box)  # -> Volume, Centroid
project = Project(Geometry=volume.Centroid, Plane=PlaneXY(0, 0, 0))  # -> Geometry, Transform

bounding_box_2 = BoundingBox(Content=mesh_2, Plane=PlaneXY(0, 0, 0))  # -> Box, Box_2
volume_2 = Volume(Geometry=bounding_box_2.Box)  # -> Volume, Centroid
project_2 = Project(Geometry=volume_2.Centroid, Plane=PlaneXY(0, 0, 0))  # -> Geometry, Transform

# ----
# EACH ITEM HAS AN INDEX.
# INDICES ARE REPRESENTED
# BY THE NUMBERS ON THE LEFT
# OF THE LIST
panel = Panel(mesh)

# ----
# 2
curve = Curve([<curve referenced from the Rhino model> x3])
# 1
mesh_5 = Mesh(<mesh referenced from the Rhino model>)

# ----
# TOPIC 4 - GRAFTING
# NOTICE THAT EACH TREE IS IN ITS
# OWN PATH. PATH IS THE NUMBER
# IN THE UPPER RIGHT. YOU CAN
# THINK OF IT AS A BOX THAT
# CONTAINS ITEMS
param_viewer = ParamViewer(mesh_4)
# SIMPLIFY EVERYTHING
panel_2 = Panel(mesh_4)

# ---- group: CENTER POINTS FOR ALL THE MESHES
bounding_box_3 = BoundingBox(Content=mesh_4, Plane=PlaneXY(0, 0, 0))  # -> Box, Box_2
volume_3 = Volume(Geometry=bounding_box_3.Box)  # -> Volume, Centroid
project_3 = Project(Geometry=volume_3.Centroid, Plane=PlaneXY(0, 0, 0))  # -> simplify(Geometry), Transform

# ---- group: HOW MANY TREES IN EACH PARTITION
tree_statistics = TreeStatistics(Tree=mesh_4)  # -> Paths, Length, Count
division = Division(A=of_trees, B=tree_statistics.Count)
round = Round(Number=division)  # -> Nearest, Floor, Ceiling

# ----
# TOPIC 2 - DEFAULT MATCHING BEHAVIOUR
# EACH ITEM HAS AN INDEX.
# INDICES ARE REPRESENTED
# BY THE NUMBERS ON THE LEFT
# OF THE LIST
panel_3 = Panel(mesh_2)

# ----
# TOPIC 3 - INDEX TO INDEX DATA MATCHING
# EACH ITEM HAS AN INDEX.
# INDICES ARE REPRESENTED
# BY THE NUMBERS ON THE LEFT
# OF THE LIST
panel_4 = Panel(mesh_3)

# ----
# 3
loft = Loft(Curves=curve, Options={Adjust=False, Closed=False, LoftEnds=0, LoftSimp=0, LoftType=0, Rebuild=10, Refit=0.01})
# 5
bounding_box_4 = BoundingBox(Content=mesh_5, Plane=PlaneXY(0, 0, 0))  # -> Box, Box_2

# ----
# 4
md_slider = MDSlider(
    SliderMode=0,
    slider_value=Point(0.459665873, 0.5960339802, 0.5),
    x_domain=Domain(0, 1),
    y_domain=Domain(0, 1),
    z_domain=Domain(0, 1))
evaluate_surface = EvaluateSurface(Surface=reparameterize(loft), Point=md_slider)  # -> Point, Normal, UDirection, VDirection, Frame

# ----
# FROM THE PREVIOUS LESSON
mesh_6 = Mesh(list_item)
curve_2 = Curve([<curve referenced from the Rhino model> x3])
loft_2 = Loft(Curves=curve_2, Options={Adjust=False, Closed=False, LoftEnds=0, LoftSimp=0, LoftType=0, Rebuild=10, Refit=0.01})
bounding_box_5 = BoundingBox(Content=mesh_6, Plane=PlaneXY(0, 0, 0))  # -> Box, Box_2

# ----
# 6
box_corners = BoxCorners(Box=bounding_box_4.Box)  # -> CornerA, CornerB, CornerC, CornerD, CornerE, CornerF, CornerG, CornerH
average = Average(Input=[box_corners.CornerA, box_corners.CornerC])

# ----
# WHEN WE ARE MATCHING
# INDEX TO INDEX WE WANT
# TO HAVE THE SAME NUMBER
# OF ITEMS IN EACH LIST
panel_5 = Panel(project_2.Geometry)

# ----
# WHEN WE ARE MATCHING
# INDEX TO INDEX WE WANT
# TO HAVE THE SAME NUMBER
# OF ITEMS IN EACH LIST
panel_6 = Panel(project.Geometry)

md_slider_2 = MDSlider(
    SliderMode=0,
    slider_value=Point(0.7840618455, 0.7023319151, 0.5),
    x_domain=Domain(0, 1),
    y_domain=Domain(0, 1),
    z_domain=Domain(0, 1))
evaluate_surface_2 = EvaluateSurface(Surface=reparameterize(loft_2), Point=md_slider_2)  # -> Point, Normal, UDirection, VDirection, Frame

# ----
# 9
number_slider_4 = Slider(39, range=0..360)
rotate_plane = RotatePlane(Plane=evaluate_surface.Frame, Angle=degrees(number_slider_4))

# ----
# FROM THE PREVIOUS LESSON
curve_3 = Curve([<curve referenced from the Rhino model> x3])
loft_3 = Loft(Curves=curve_3, Options={Adjust=False, Closed=False, LoftEnds=0, LoftSimp=0, LoftType=0, Rebuild=10, Refit=0.01})

md_slider_3 = MDSlider(
    SliderMode=0,
    slider_value=Point(0.7840618455, 0.7023319151, 0.5),
    x_domain=Domain(0, 1),
    y_domain=Domain(0, 1),
    z_domain=Domain(0, 1))
evaluate_surface_3 = EvaluateSurface(Surface=reparameterize(loft_3), Point=md_slider_3)  # -> Point, Normal, UDirection, VDirection, Frame

box_corners_2 = BoxCorners(Box=bounding_box_5.Box)  # -> CornerA, CornerB, CornerC, CornerD, CornerE, CornerF, CornerG, CornerH
average_2 = Average(Input=[box_corners_2.CornerA, box_corners_2.CornerC])

# ----
# FROM THE PREVIOUS LESSON
curve_4 = Curve([<curve referenced from the Rhino model> x3])
loft_4 = Loft(Curves=curve_4, Options={Adjust=False, Closed=False, LoftEnds=0, LoftSimp=0, LoftType=0, Rebuild=10, Refit=0.01})

partition_list = PartitionList(List=construct_point_2, Size=round.Nearest)  # -> simplify(Chunks)

# ----
# 7
vector_2pt = Vector2Pt(PointA=average, PointB=evaluate_surface.Point, Unitize=False)  # -> Vector, Length
move = Move(Geometry=mesh_5, Motion=vector_2pt.Vector)  # -> Geometry, Transform

# ----
# NOTE THAT AFTER SIMPLIFYING
# OUR PATHS ARE MATCHED.
# GRASSHOPPER CAN NOW MATCH
# PATH TO PATH, AND THEM DO THE
# STANDARD LONGEST LIST MATCHING
# WITHIN EACH PATH.
param_viewer_2 = ParamViewer(partition_list)
panel_7 = Panel(partition_list)

# ----
# 10
xy_plane = XYPlane(Origin=average)
orient = Orient(Geometry=mesh_5, Source=xy_plane, Target=rotate_plane)  # -> Geometry, Transform

rotate_plane_2 = RotatePlane(Plane=evaluate_surface_2.Frame, Angle=degrees(Slider(39, range=0..360)))

evaluate_surface_4 = EvaluateSurface(Surface=reparameterize(loft_4), Point=construct_point)  # -> Point, Normal, UDirection, VDirection, Frame

vector_display = VectorDisplay(Anchor=evaluate_surface.Point, Vector=vector_2pt.Vector)

# ---- group: Vector Display
# 8
vector_display_2 = VectorDisplay(Anchor=average, Vector=vector_2pt.Vector)

# ----
# FROM THE PREVIOUS LESSON
curve_5 = Curve([<curve referenced from the Rhino model> x3])
loft_5 = Loft(Curves=curve_5, Options={Adjust=False, Closed=False, LoftEnds=0, LoftSimp=0, LoftType=0, Rebuild=10, Refit=0.01})

# ---- group: visualizing the data matching
line = Line(StartPoint=project.Geometry, EndPoint=evaluate_surface_4.Point)

# ----
rotate_plane_3 = RotatePlane(Plane=evaluate_surface_3.Frame, Angle=degrees(Slider(39, range=0..360)))

xy_plane_2 = XYPlane(Origin=average_2)
orient_2 = Orient(Geometry=mesh_6, Source=xy_plane_2, Target=rotate_plane_2)  # -> Geometry, Transform

xy_plane_3 = XYPlane(Origin=project_2.Geometry)
orient_3 = Orient(Geometry=mesh_2, Source=xy_plane_3, Target=rotate_plane_3)  # -> Geometry, Transform

rotate_plane_4 = RotatePlane(Plane=evaluate_surface_4.Frame, Angle=degrees(Slider(196, range=0..360)))

evaluate_surface_5 = EvaluateSurface(Surface=reparameterize(loft_5), Point=partition_list)  # -> Point, Normal, UDirection, VDirection, Frame

xy_plane_4 = XYPlane(Origin=project.Geometry)
orient_4 = Orient(Geometry=mesh_3, Source=xy_plane_4, Target=rotate_plane_4)  # -> Geometry, Transform

rotate_plane_5 = RotatePlane(Plane=evaluate_surface_5.Frame, Angle=degrees(Slider(196, range=0..360)))

xy_plane_5 = XYPlane(Origin=project_3.Geometry)
orient_5 = Orient(Geometry=mesh_4, Source=xy_plane_5, Target=rotate_plane_5)  # -> Geometry, Transform
