# Grasshopper definition 24-02-08-Data and List Management.gh (Grasshopper 1.0.7)
# plug-ins: Bifocals

number_slider = Slider(2, range=0..2)

crv = Curve(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)
divide = DivideCurve(Curve=crv, Count=Slider(4, range=0..10), Kinks=False)  # -> Points, Tangents, Parameters
index = ItemIndex(List=divide.Points, Item=divide.Points)
tag = TextTag3D(Location=divide.Points, Text=index, Size=number_slider, Colour=RGB(0, 115, 255), Justification=4)

# ----
# DATA MATCHING
number_slider_2 = Slider(4, range=0..10)
crv_2 = Curve(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)
divide_2 = DivideCurve(Curve=crv_2, Count=number_slider_2, Kinks=False)  # -> Points, Tangents, Parameters
index_2 = ItemIndex(List=divide_2.Points, Item=divide_2.Points)
tag_2 = TextTag3D(Location=divide_2.Points, Text=index_2, Size=number_slider, Justification=6)

# ----
# LONGEST LIST (DEFAULT)
pt = Point(divide_2.Points)
pt_2 = Point(divide.Points)
ln = Line(StartPoint=pt, EndPoint=pt_2)
viewer = ParamViewer(ln)

# ----
# REVERSE LIST OF DATA
pt_3 = Point(divide_2.Points)
pt_4 = Point(divide.Points)
ln_2 = Line(StartPoint=reverse(pt_3), EndPoint=pt_4)
viewer_2 = ParamViewer(ln_2)

# ----
# FLATTEN LIST
pt_5 = Point(divide_2.Points)
pt_6 = Point(divide.Points)
ln_3 = Line(StartPoint=pt_5, EndPoint=pt_6)
viewer_3 = ParamViewer(ln_3)
# Flattening a list will remove the previous data structure.  Grasshopper uses tree 'branches' as a metaphor for illustrating data structure.
# 
# In general, unless there is a very specific reason for having data separated into branches, it makes sense to keep the data structure simple.
param_viewer = ParamViewer(ln_3)

# ----
# GRAFT DATA (LIST A)
pt_7 = Point(divide_2.Points)
pt_8 = Point(divide.Points)
ln_4 = Line(StartPoint=graft(pt_7), EndPoint=pt_8)
viewer_4 = ParamViewer(ln_4)
# Grafting a list will introduce an additional layer of data structure, or in other words, new branches.
param_viewer_2 = ParamViewer(ln_4)

# ----
# GRAFT DATA (LIST B)
pt_9 = Point(divide_2.Points)
pt_10 = Point(divide.Points)
ln_5 = Line(StartPoint=pt_9, EndPoint=graft(pt_10))
viewer_5 = ParamViewer(ln_5)
param_viewer_3 = ParamViewer(ln_5)

# ----
# SHORTEST LIST
pt_11 = Point(divide_2.Points)
pt_12 = Point(divide.Points)
short = ShortestList(ListA=pt_11, ListB=pt_12, TrimMode=2)  # -> ListA, ListB
ln_6 = Line(StartPoint=short.ListA, EndPoint=short.ListB)
viewer_6 = ParamViewer(ln_6)

# ----
# NUMERIC
# SLIDER
# The Slider Component(Params>Input>Slider) creates a single number as output. The slider is NOT parametrizable and has the following properties:
# 
# - Domain (smallest and largest number)
# - Number Type (Integer, Float, Even, Odd)
# 
# Note: Access properties by double-clicking on Slider's dark gray area.
number_slider_3 = Slider(0.25, range=0..1)
pt_x = Slider(10, range=0..10)
pt_y = Slider(8, range=0..10)
pt_z = Slider(8, range=0..10)
panel = Panel([pt_x, pt_y, pt_z])
pt_13 = ConstructPoint(XCoordinate=pt_x, YCoordinate=pt_y, ZCoordinate=pt_z)
preview = CustomPreview(
    Geometry=pt_13,
    Shader={diffuse=RGB(34, 139, 34), emission=RGB(76, 32, 54), shine=0.5, specular=RGB(255, 255, 255), transparency=0})

# ----
# SERIES
# The Series Component (Set>Sequence>Series) creates a list of numbers increasing at a fixed rate (e.g: 2,4,6,8 or  0,4,8,12). It has three parametrizable inputs:
# 
# - (S) Start (first number in the series)
# - (N) Step (increment number at each step)
# - (C) Count (number of values in the series)
series = Series(Start=0, Step=1, Count=10)
grid_start = Slider(0, range=0..10)
grid_spacing = Slider(7, range=0..10)
grid_extent = Slider(10, range=0..10)
series_2 = Series(Start=grid_start, Step=grid_spacing, Count=grid_extent)
panel_2 = Panel(series_2)
pt_14 = ConstructPoint(XCoordinate=expr("x+40", graft(series_2)), YCoordinate=series_2, ZCoordinate=0)
preview_2 = CustomPreview(
    Geometry=pt_14,
    Shader={diffuse=RGB(255, 69, 0), emission=RGB(76, 32, 54), shine=0.5, specular=RGB(255, 255, 255), transparency=0})

# ----
# RANGE
# The Range Component (Set>Sequence>Range) creates several numbers that are homogeneously distributed within a numeric domain (e.g: 10 numbers between 0 and 10 or 5 numbers between 20 and 45). It has two parametrizable inputs:
# 
# - (D) Domain (Numeric domain for operating at)
# - (N) Steps (Domain's divisions – Number of values to get from the domain).
# 
# Note: The number of values that Range will output will be (N)+1 (e.g: If the number of steps is 9, Range will output 10 values)
range = Range(Domain=Domain(0, 1), Steps=10)
grid_extent_2 = Slider(60, range=0..110)
grid_resolution = Slider(10, range=0..10)
range_2 = Range(Domain=grid_extent_2, Steps=grid_resolution)
panel_3 = Panel(range_2)
pt_15 = ConstructPoint(XCoordinate=expr("x+140", graft(range_2)), YCoordinate=range_2, ZCoordinate=0)
preview_3 = CustomPreview(
    Geometry=pt_15,
    Shader={diffuse=RGB(30, 144, 255), emission=RGB(76, 32, 54), shine=0.5, specular=RGB(255, 255, 255), transparency=0})

# ----
# RANDOM
# The Random Component (Set>Sequence>Random) creates several numbers that are homogeneously randonmly within a numeric domain (e.g: 10 random numbers between 0 and 10 or 5 random numbers between 20 and 45). It has three parametrizable inputs:
# 
# - (R) Range (Numeric domain for operating at)
# - (N) Number (Number of random values)
# - (S) Seed (Random generator seed – modify for different random solutions)
random = Random(Range=Domain(0, 1), Number=1, Seed=2)
grid_max_extent = Slider(63, range=0..110)
grid_resolution_2 = Slider(7, range=0..10)
random_seed = Slider(53, range=0..100)
random_2 = Random(Range=grid_max_extent, Number=grid_resolution_2, Seed=random_seed)
panel_4 = Panel(random_2)
pt_16 = ConstructPoint(XCoordinate=expr("x+240", graft(random_2)), YCoordinate=random_2, ZCoordinate=0)
preview_4 = CustomPreview(
    Geometry=pt_16,
    Shader={diffuse=RGB(186, 85, 211), emission=RGB(76, 32, 54), shine=0.5, specular=RGB(255, 255, 255), transparency=0})

# ----
# DATA MANAGEMENT
# LIST ITEM
# The list item component allows you to select an item from the list based on the item's index.
# 
# In addition, if 'Wrap' is set to true, you can access items from the end of the list. For example, index = -1 gives you the last item, index = -2 gives you the second last item, etc.
list_item = ListItem(List=0, Index=0, Wrap=True)
item_index = Slider(0, range=-6..6)
list_0 = Panel("""A
B
C
D
E
F
G""")
list_item_2 = ListItem(List=list_0, Index=item_index, Wrap=True)
selected_item = Panel(list_item_2)

# ----
# STREAM FILTER
# The Stream Filter Component (Sets>Tree>Stream Filter) receives multiple input streams allowing only one to be output. It has two types of inputs:
# 
# - (G) Gate: Index of stream that will be output.
# - (0) Input List to be filtered (as many as necessary)
# 
# The component will receive all the data streams, and will filter everyone but the one whose index matches the index provided in the Gate input (e.g: If there are 10 different input streams, and the index provided in the Gate input is '4', then the input stream number 4 will be the output).
filter = StreamFilter(Gate=0)
list_0_2 = Panel("""A
B
C
D
E
F
G""")
list_1 = Panel("""1
2
3
4
5
6
7""")
filter_2 = StreamFilter(Gate=Slider(1, range=0..1), Stream0=list_0_2, Stream1=list_1)
filtered_stream = Panel(filter_2)

# ----
# MERGE
# The Merge Component (Sets>Tree>Merge) combines multiple data streams into one data set. It has as many inputs as the user needs:
# 
# - (D1) First data stream to merge
# - (Dn) N data stream to merge
# 
# The component will add one list at a time, with the output data resulting on all the original lists together, one after another.
merge = Merge()
list_a = Panel("""A
B
C
D
E
F
G""")
list_b = Panel("""1
2
3
4
5
6
7""")
merge_2 = Merge(Data1=list_a, Data2=list_b)
merged_list = Panel(merge_2)

# ----
# WEAVE
# The Weave Component (Sets>List>Weave) combines multiple data streams into one data set using a weaving pattern. It has two types of inputs:
# 
# - (P) Pattern: Pattern for combining the different input lists
# - (0) Input List to be woven (as many as required)
# 
# The component will pick elements from each list depending on the weaving pattern provided (e.g: for the weaving pattern '0,1,0,2' the component will pick an element from List 0, then an element from List 1, then an element from List 0, then an element from List 2, and then it will start again repeating the pattern).
weave = Weave(Pattern=[0, 1], Stream0=1, Stream1=2, NullGaps=False)
list_0_3 = Panel("""A
B
C
D
E
F
G""")
list_1_2 = Panel("""1
2
3
4
5
6
7""")
weave_2 = Weave(Pattern=[0, 1], Stream0=list_0_3, Stream1=list_1_2, NullGaps=False)
woven_list = Panel(weave_2)

# ----
# DISPATCH
# The Dispatch Component (Sets>List>Dispatch) receives a data list and redirect its element to one of two different outputs, based on a boolean mask. It has two inputs:
# 
# - (L) List: Set of elements to operate on
# - (P) Dispatch Pattern: Boolean pattern for redirecting the input list elements.
# 
# Note: A boolean pattern is a collection of numbers (usually 0 and 1 – if a number larger than one is provided it will be considered as a '1'. In a more general note, a boolean value is a logic operator (true or false) for perfoming a logic operation (do 'action' if the element is 'true/false')
dispatch = Dispatch(List=1, DispatchPattern=[True, False])  # -> ListA, ListB
original_list = Panel("""A
1
B
2
C
3
D
4
E
5
F
6
G
7""")
dispatch_2 = Dispatch(List=original_list, DispatchPattern=[True, False])  # -> ListA, ListB
re_directed_list_a = Panel(dispatch_2.ListA)
re_directed_list_b = Panel(dispatch_2.ListB)

# ----
# CULL PATTERN
# The Cull Pattern Component (Sets>Sequence>Cull Pattern) receives a data list and then culls it based on a boolean pattern. It has two inputs:
# 
# - (L) List: Set of elements to operate on
# - (P) Cull Pattern: Boolean pattern for removing or keeping the list' elements.
# 
# Note: A boolean pattern is a collection of numbers (usually 0 and 1 – if a number larger than one is provided it will be considered as a '1'. In a more general note, a boolean value is a logic operator (true or false) for perfoming a logic operation (do 'action' if the element is 'true/false')
cull = CullPattern(List=1, CullPattern=[False, False, True, True])
original_list_2 = Panel("""A
B
C
D
E
F
G""")
cull_2 = CullPattern(List=original_list_2, CullPattern=[True, False])
culled_list = Panel(cull_2)
